# Grasshopper definition gHowl_UDP_send+receive.ghx (Grasshopper 0.9.75)
# plug-ins: Anemone, gHowl

port = Panel("7001")
udp_owl = UDPReceiver(Port=port, Pattern=0)  # -> Info, Data
panel = Panel(udp_owl.Data)
split = StringSplit(String=udp_owl.Data, Separators=";")
lng = ListLength(List=split)
division = Division(A=lng, B="4")
lng_2 = ListLength(List=split)
# most basic loop:
panel_2 = Panel("10")
panel_3 = Panel(split)
loop_start = LoopStart(Repeat=division, Data_0=split)  # -> port, Counter, Data_0
# nested loop:
# will error out if loop end has diffferent number of data streams -
# just add empty param to the loop start
loop_start_2 = LoopStart(Repeat=0, Data_0=split)  # -> port, Counter, Data_0, Data_1
panel_4 = Panel(division)
partition = PartitionList(List=split, Size="4")
# loop with data list input:
# N-counter loops is 0-indexed and
# counter loops are in addition to the values of the data stream!
panel_5 = Panel("0")
loop_start_3 = LoopStart(Repeat=panel_2, Data_0="0")  # -> port, Counter, Data_0
panel_6 = Panel(loop_start_2.Data_0)
loop_start_4 = LoopStart(Repeat=panel_5, Data_0=panel_3)  # -> port, Counter, Data_0
split_2 = SplitList(List=loop_start.Data_0, Index="4")  # -> ListA, ListB
bang = ExplodeTree(Data=partition)  # -> Branch0, Branch1
panel_7 = Panel(loop_start_3.Data_0)
panel_8 = Panel(split_2.ListA)
split_3 = SplitList(List=loop_start_2.Data_0, Index="4")  # -> ListA, ListB
panel_9 = Panel(loop_start_4.Data_0)
split_2_2 = SplitList(List=bang.Branch0, Index=2)  # -> ListA, ListB
addition = Addition(A=loop_start_3.Data_0, B="4")
panel_10 = Panel(split_3.ListB)
loop_start_5 = LoopStart(Repeat=0, Trigger=loop_start_2.Counter, Data_0=split_3.ListA, Data_1=split_3.ListB)  # -> port, Counter, Data_0, Data_1
addition_2 = Addition(A=loop_start_4.Data_0, B="4")
panel_11 = Panel(addition)
# try either domain box or center box!
split_4 = SplitList(List=split_2_2.ListA, Index=1)  # -> ListA, ListB
loop_end = LoopEnd(port=loop_start.port, Exit=False, Data_0=split_2.ListB, pausedState=False, state="Constant output")
split_1 = SplitList(List=split_2_2.ListB, Index=1)  # -> ListA, ListB
loop_end_2 = LoopEnd(port=loop_start_3.port, Exit=False, Data_0=addition, pausedState=False, state="Constant & Record")
loop_end_3 = LoopEnd(port=loop_start_4.port, Exit=False, Data_0=addition_2, pausedState=False, state="Constant & Record")
panel_12 = Panel(addition_2)
pt = ConstructPoint(XCoordinate=split_4.ListA, YCoordinate=split_4.ListB, ZCoordinate=0)
addition_3 = Addition(A=loop_start_5.Data_0, B="2")
addition_4 = Addition(A=loop_start_5.Data_1, B="4")
split_2_3 = SplitList(List=bang.Branch1, Index=2)  # -> ListA, ListB
panel_13 = Panel(loop_end)
panel_14 = Panel(loop_end_2)
panel_15 = Panel(loop_end_3)
loop_end_4 = LoopEnd(port=loop_start_5.port, Exit=False, Data_0=addition_3, Data_1=addition_4, pausedState=False, state="Last & Record")  # -> Data_0, Data_1
split_5 = SplitList(List=split_2_3.ListA, Index=1)  # -> ListA, ListB
box = DomainBox(Base=pt, X=split_1.ListA, Y=split_1.ListB, Z=Domain(0, 2))
split_1_2 = SplitList(List=split_2_3.ListB, Index=1)  # -> ListA, ListB
pt_2 = ConstructPoint(XCoordinate=split_5.ListA, YCoordinate=split_5.ListB, ZCoordinate=0)
loop_end_5 = LoopEnd(
    port=loop_start_2.port,
    Exit=False,
    Data_0=loop_end_4.Data_0,
    Data_1=loop_end_4.Data_1,
    pausedState=False,
    state="Last & Record")  # -> Data_0, Data_1
box_2 = DomainBox(Base=pt_2, X=split_1_2.ListA, Y=split_1_2.ListB, Z=Domain(0, 2))
panel_16 = Panel(loop_end_5.Data_0)
panel_17 = Panel(loop_end_5.Data_1)
